# Grasshopper definition parPCPTest.gh (Grasshopper 0.9.76)
# plug-ins: Heteroptera, Telepathy, Impala

rnd_vector = RandomVector(Number=Slider(4000, range=0..10000), Length=Slider(20, range=0..100))
rnd_vector_2 = RandomVector(Number=Slider(5000, range=0..10000), Length=Domain(1, 5))
number_slider = Slider(2, range=0..100)
partition = PartitionList(List=rnd_vector, Size=Slider(50, range=0..100))
partition_2 = PartitionList(List=rnd_vector_2, Size=Slider(1000, range=0..1000))
pt = Point(partition)
pt_2 = Point(partition_2)
cps = ClosestPoints(Point=pt, Cloud=pt_2, Count=number_slider)  # -> ClosestPoint, CPIndex, Distance
parpointcp = ParPointCP(Points=pt, Cloud=pt_2, Number=number_slider)  # -> Points, Indices
dist = Distance(PointA=cps.ClosestPoint, PointB=parpointcp.Points)
num = Number(cps.CPIndex)
num_2 = Number(parpointcp.Indices)
qeq = QuickEq(A=dist, B=Slider(0, range=0..1))  # -> flatten(R)
qeq_2 = QuickEq(A=num, B=num_2)  # -> flatten(R)
cset = CreateSet(List=qeq_2)  # -> Set, Map
cset_2 = CreateSet(List=qeq)  # -> Set, Map
and = GateAnd(A=cset_2.Set, B=cset.Set)
correct = RemoteSender(and)
correct_2 = RemoteReceiver(correct)
panel = Panel(correct_2)
