# Grasshopper definition remduplntest.gh (Grasshopper 0.9.76)
# plug-ins: Heteroptera, Impala

medium_test = Slider(75000, range=0..100000)
small_test = Slider(2302, range=0..10000)
large_test = Slider(300000, range=0..1000000)

# ---- group: Generate random (and some duplicate, backwards) lines
rnd_vector = RandomVector(Number=small_test, Length=Domain(1, 5))
lng = ListLength(List=rnd_vector)
pt = Point(rnd_vector)
division = Division(A=lng, B=2)
split = SplitList(List=pt, Index=division)  # -> ListA, ListB
multiplication = Multiplication(A=division, B=Slider(0, range=0..1))
ln = Line(StartPoint=split.ListA, EndPoint=split.ListB)
ln_2 = Line(StartPoint=split.ListA, EndPoint=split.ListB)
reduce = RandomReduce(List=ln_2, Reduction=multiplication, Seed=1)
merge = Merge(Data1=flatten(ln), Data2=flatten(reduce))

# ---- group: super slow (don't run w/ many lines)
seqremduplns = SeqRemDupLns(Lines=merge, Tolerance=0.01)  # disabled

# ---- group: Test with many identical, duplicate lines
rnd_vector_2 = RandomVector(Number=Slider(4, range=0..10), Length=Domain(1, 5))
item = ListItem(List=rnd_vector_2, Index=0, Wrap=True)  # -> Item, Item1, Item2, Item3
number_slider = Slider(250, range=0..10000)
ln_3 = Line(StartPoint=item.Item2, EndPoint=item.Item3)
ln_4 = Line(StartPoint=item.Item, EndPoint=item.Item1)
repeat = RepeatData(Data=[ln_4, ln_3], Length=Slider(3999, range=0..10000))

# ----
parremduplns = ParRemDupLns(Lines=repeat, Tolerance=0.01, Granularity=number_slider)

# ---- group: Test with many identical, duplicate lines (continued)
panel = Panel(parremduplns)

# ----
number_slider_2 = Slider(0.001, range=0..0.001)

parremduplns_2 = ParRemDupLns(Lines=merge, Tolerance=Slider(1e-05, range=0..1e-05), Granularity=Slider(274, range=0..1000))

line = Line(parremduplns_2)

# ---- group: Are we producing the right # of lines?
lng_2 = ListLength(List=line)
lng_3 = ListLength(List=ln)
equals = Equality(FirstNumber=lng_2, SecondNumber=lng_3)  # -> Equality, Inequality
panel_2 = Panel(equals.Equality)

# ---- group: Test Equality
lng_4 = ListLength(List=seqremduplns)
lng_5 = ListLength(List=line)
len = Length(Curve=line)  # disabled
len_2 = Length(Curve=seqremduplns)
cset = CreateSet(List=len_2)  # -> Set, Map
cset_2 = CreateSet(List=len)  # -> Set, Map
equals_2 = Equality(FirstNumber=lng_4, SecondNumber=lng_5)  # -> Equality, Inequality
sort = SortList(Keys=cset.Set)  # -> Keys, ValuesA
sort_2 = SortList(Keys=cset_2.Set)  # -> Keys, ValuesA
equals_3 = Equality(FirstNumber=sort.Keys, SecondNumber=sort_2.Keys)  # -> Equality, Inequality
ma = MassAddition(Input=equals_3.Inequality)  # -> Result, PartialResults
equals_4 = Equality(FirstNumber=ma.Result, SecondNumber=0)  # -> Equality, Inequality
and = GateAnd(A=equals_2.Equality, B=equals_4.Equality)
